# Grasshopper definition SurfaceBuild.gh (Grasshopper 1.0.7)
# plug-ins: Human, DendroGH, MeshEdit Components

number_slider = Slider(6, range=0..100)
number_slider_2 = Slider(30, range=0..100)
number_slider_3 = Slider(6, range=0..10)
number_slider_4 = Slider(30, range=0..100)
pt = Point(<point referenced from the Rhino model>)
panel = Panel("""6
11
16
21
26""")
c_script = CSharpScript(S=pt, NY=number_slider_2, NX=number_slider_4, DY=number_slider, DX=number_slider_3)  # -> out, P; inputs S: Point3d, NY: Int32, NX: Int32, DY: Double, DX: Double
# ---------- c_script: C# ----------
    DataTree<Point3d> pts = new DataTree<Point3d>();

    for(int j = 0; j < NY; j++){


      double y = S.Y + DY * j;
      GH_Path path = new GH_Path(j);

      for(int i = 0; i < NX; i++){

        double x = S.X + DX * i;


        Point3d p = new Point3d(x, y, S.Z);

        
        pts.Add(p, path);
      }

    }

    P = pts;
# ---------- end c_script ----------
c_script_2 = CSharpScript(S=pt, NY=number_slider_2, NX=number_slider_4, DY=number_slider, DX=number_slider_3)  # -> out, P; inputs S: Point3d, NY: Int32, NX: Int32, DY: Double, DX: Double; disabled
# ---------- c_script_2: C# ----------
    List<Point3d> pts = new List<Point3d>();

    for(int j = 0; j < NY; j++){

      double y = S.Y + DY * j;
      for(int i = 0; i < NX; i++){

        double x = S.X + DX * i;
        Point3d p = new Point3d(x, y, S.Z);

        pts.Add(p);
      }

    }

    P = pts;
# ---------- end c_script_2 ----------
pt_2 = Point(<point referenced from the Rhino model>)
data = Data(c_script.P)
c_script_3 = CSharpScript(
    S=pt_2,
    NY=Slider(10, range=0..100),
    NX=Slider(10, range=0..100),
    DY=Slider(5, range=0..100),
    DX=Slider(5, range=0..10),
    v=Slider(1, range=0..10))  # -> out, P; inputs S: Point3d, NY: Int32, NX: Int32, DY: Double, DX: Double, v: Double; disabled
# ---------- c_script_3: C# ----------
    List<Point3d> pts = new List<Point3d>();

    for(int j = 0; j < NY; j++){

      double y = S.Y + DY * j;
      for(int i = 0; i < NX; i++){

        double x = S.X + DX * i;
        for(int k = 0; k < NX; k++){

         
          double z = S.Z + v * k;
          Point3d p = new Point3d(x, y, z);

          pts.Add(p);
        }
    //    double z = S.Z + v * i;
    //    Point3d p = new Point3d(x, y, z);

     //   pts.Add(p);
      }

    }

    P = pts;
# ---------- end c_script_3 ----------
c_script_4 = CSharpScript(L=panel)  # -> out, A; inputs L: list of Int32
# ---------- c_script_4: C# ----------
    List<int> test = new List<int>();
    int t = 0;

    for(int i = 0; i < L.Count; i++){

      t = L[i];

      t = t + 1;
      //v = v - 1;
      test.Add(t);
      //test.Add(v);
      //test.Add(L[i - 1]);
    }

    A = test;
# ---------- end c_script_4 ----------
c_script_5 = CSharpScript(L=c_script_4.A)  # -> out, A; inputs L: list of Int32; same code as c_script_4
dom = ConstructDomain(DomainStart=Slider(5, range=0..100), DomainEnd=Slider(25, range=0..100))
c_script_6 = CSharpScript(L1=c_script_4.A, L2=c_script_5.A, L3=panel)  # -> out, graft(A); inputs L1: list of Int32, L2: list of Int32, L3: list of Int32
# ---------- c_script_6: C# ----------
    List<int> test = new List<int>();
    int t = 0;
    int v = 0;
    int k = 0;
    for(int i = 0; i < L1.Count; i++){

      t = L1[i];

      test.Add(t);
    }
    for(int i = 0; i < L2.Count; i++){

      v = L2[i];

      test.Add(v);
    }
    for(int i = 0; i < L3.Count; i++){

      k = L3[i];

      test.Add(k);
    }

    A = test;
# ---------- end c_script_6 ----------
del3d = _3DDelaunay(Points=c_script_3.P)  # -> TopologicalEdges, Connectivity; disabled
c_script_7 = CSharpScript(T=data, i=panel)  # -> out, A; inputs T: tree, i: Int32
# ---------- c_script_7: C# ----------
    DataTree<object> clean = new DataTree<object>();

    List<object> branch = T.Branches[i];
    GH_Path path = T.Paths[i];

    clean.AddRange(branch, path);
    A = clean;
# ---------- end c_script_7 ----------
c_script_8 = CSharpScript(T=c_script.P, i=c_script_4.A)  # -> out, A; inputs T: tree, i: Int32; same code as c_script_7
c_script_9 = CSharpScript(T=c_script.P, i=c_script_5.A)  # -> out, A; inputs T: tree, i: Int32; same code as c_script_7
merge = Merge(Data1=c_script_5.A, Data2=c_script_4.A, Data3=panel)
prox = Proximity3D(Points=c_script_3.P, Group=5, MinRadius=Slider(0, range=0..100))  # -> Links, Topology
number_slider_5 = Slider(1, range=0..1)
range = Range(Domain=dom, Steps=Slider(4, range=0..10))
c_script_10 = CSharpScript(L=range)  # -> out, A; inputs L: list of Int32
# ---------- c_script_10: C# ----------
    List<int> test = new List<int>();
    int t = 0;
    int v = 0;
    for(int i = 0; i < L.Count; i++){

      t = L[i];
      v = L[i];
      test.Add(L[i]);

      t = t + 1;
      v = v - 1;
      test.Add(t);
      test.Add(v);
      //test.Add(L[i - 1]);
    }

    A = test;
# ---------- end c_script_10 ----------
crv = Curve(flatten(prox.Links))
sort = SortList(Keys=merge, ValuesA=merge)  # -> Keys, ValuesA
vsettings = CreateSettings(VoxelSize=Slider(0.4, range=0..1), Bandwidth=1, Isovalue=0, Adaptivity=0.1)
c_script_11 = CSharpScript(L=c_script_10.A)  # -> out, A; inputs L: list of Int32; same code as c_script_10
item = ListItem(List=c_script_8.A, Index=c_script_10.A, Wrap=True)
item_2 = ListItem(List=c_script_7.A, Index=range, Wrap=True)
number_slider_6 = Slider(10, range=0..10)
panel_2 = Panel(sort.ValuesA)
vsettings_2 = CreateSettings(VoxelSize=Slider(1, range=0..1), Bandwidth=1, Isovalue=0, Adaptivity=0.1)
vpoints = PointsToVolume(Points=c_script_3.P, PointRadius=Slider(0.3, range=0..1), Settings=vsettings_2)  # disabled
subtraction = Subtraction(A=number_slider_6, B=Slider(2, range=0..10))
item_3 = ListItem(List=c_script_9.A, Index=c_script_11.A, Wrap=True)
vcurve = CurveToVolume(Curves=crv, CurveRadius=Slider(2, range=0..10), Settings=vsettings)
Z = UnitZ(Factor=number_slider_6)
Z_2 = UnitZ(Factor=subtraction)
subtraction_2 = Subtraction(A=subtraction, B=Slider(2, range=0..10))
move = Move(Geometry=item, Motion=Z_2)  # -> Geometry, Transform
move_2 = Move(Geometry=item_2, Motion=Z)  # -> Geometry, Transform
Z_3 = UnitZ(Factor=subtraction_2)
volume = Volume(vcurve)
move_3 = Move(Geometry=item_3, Motion=Z_3)  # -> Geometry, Transform
mvolume = VolumeToMesh(Volume=volume, VolumeSettings=vsettings)
replace = ReplaceItems(List=c_script_8.A, Item=move.Geometry, Indices=c_script_10.A, Wrap=False)
replace_2 = ReplaceItems(List=c_script_7.A, Item=move_2.Geometry, Indices=range, Wrap=False)
replace_3 = ReplaceItems(List=c_script_9.A, Item=move_3.Geometry, Indices=c_script_11.A, Wrap=False)
mesh = Mesh(mvolume)
split = SplitTree(Data=c_script.P, Masks=flatten("{6,7,8,11,12,13,16,17,18,21,22,23,26,27,28}"))  # -> Positive, Negative
merge_2 = Merge(Data1=replace_2, Data2=replace, Data3=replace_3, Data4=split.Negative)  # -> flatten(Result)
pt_3 = Point(merge_2)
del = DelaunayMesh(Points=merge_2, Plane=PlaneXY(0, 0, 0))  # disabled
number_slider_7 = Slider(1, range=0..1)
number_slider_8 = Slider(2, range=0..10)
prox_2 = Proximity3D(Points=pt_3, Group=5)  # -> Links, Topology
mesh_2 = Mesh(del)
number_slider_9 = Slider(1, range=0..1)
crv_2 = Curve(prox_2.Links)
bake = BakeGeometry(Bake=Toggle(False), Geometry=mesh_2, DeleteOldBakes=False, PreserveTrees=False)
vsettings_3 = CreateSettings(VoxelSize=Slider(0.1, range=0..1), Bandwidth=1, Isovalue=0, Adaptivity=0.1)
context_bake = ContextBake(Geometry=mesh_2)
vcurve_2 = CurveToVolume(Curves=crv_2, CurveRadius=Slider(0.9, range=0..1), Settings=vsettings_3)
mesh_3 = Mesh(vcurve_2)
context_bake_2 = ContextBake(Geometry=mesh_3)
bake_2 = BakeGeometry(Bake=Toggle(True), Geometry=mesh_3, DeleteOldBakes=False, PreserveTrees=False)
volume_2 = Volume(vcurve_2)
mvolume_2 = VolumeToMesh(Volume=volume_2, VolumeSettings=vsettings_3)
mesh_4 = Mesh(mvolume_2)
mesh_5 = Mesh(mesh_4)
bake_3 = BakeGeometry(Bake=Toggle(True), Geometry=mesh_5, DeleteOldBakes=False, PreserveTrees=False)
context_bake_3 = ContextBake(Geometry=mesh_5)
num2pt = NumbersToPoints(Numbers=[1, 2, 3], Mask=4)  # -> flatten(Points)
del_2 = DelaunayMesh(Points=num2pt, Plane=PlaneXY(0, 0, 0))  # disabled
# for(int i = 0; i < T.BranchCount; i++){
# 
# 
#       branch.Add(T.Branches[i]);
# 
#       if(i % 4 == 0){
#         branch.Add(T.Branches[i]);
#       }
#       //       for(int j = 0; j < 15; j++){
#       //       path = T.Paths[j];
# 
#       //     }
#       //   GH_Path path = T.Paths[i];
#     }
#     GH_Path path = new GH_Path();
# 
#     clean.Add(branch);
srfgrid = SurfaceFromPoints(Points=num2pt, UCount=Slider(20, range=0..50), Interpolate=Slider(1, range=0..10))  # disabled
number_slider_10 = Slider(12, range=0..100)
data_2 = Data()
c_script_12 = CSharpScript()  # -> out, A; inputs T: tree of Point3d; disabled
# ---------- c_script_12: C# ----------
    DataTree<object> clean = new DataTree<object>();

    //List <object> branch = new List<object>();
    DataTree<Point3d> branch = new DataTree<Point3d>();
    // Point3d



    for(int j = 0; j < T.BranchCount; j++){

      A = T[j].Y;
      
     
    }
    //A = pts;
# ---------- end c_script_12 ----------
c_script_13 = CSharpScript()  # -> out, A; inputs L: list of Point3d; disabled
# ---------- c_script_13: C# ----------
    List<Point3d> test = new List <Point3d>();
    List<double> test3 = new List <double>();
    List<double> test2 = new List <double>();
    //Point3d testData;

    for(int i = 0; i < L.Count; i++){

      test.Add(L[i].Z);

      if(i % 5 == 0){

        L[i].Z = L[i].Z + 5;
        test3.Add(L[i]);
      }

    }



    // for(int j = 0; j < test.Count; j++){
    //   testData = test[j].Z;
    //   testData = testData + 4;
    // }

    A = test3;
# ---------- end c_script_13 ----------
pt2num = PointsToNumbers(Points=Point(1, 2, 3), Mask=4)
c_script_14 = CSharpScript()  # -> out, A; inputs L: list
# ---------- c_script_14: C# ----------
    object item = 0;
    
    for(int i = 0; i < L.Count; i=i+5){


     // if(i % 5 == 0){

        item = L[i];
     // }

    }
    A = item;
# ---------- end c_script_14 ----------
list_item = CSharpScript()  # -> out, A, B, C; inputs L: list of Point3d; disabled
# ---------- list_item: C# ----------
    List<Point3d> test = new List<Point3d>();
    List<Point3d> testNew = new List<Point3d>();
    //Point3d testData = new Point3d();
    double testData = 0;
    Point3d testPoint = new Point3d();


    for(int i = 0; i < L.Length; i++){

      testNew.Add(L[i]);
      
      
      
      if(i % 4 == 0){

        string str = "random";
       // testData = L[i].Z;
        //testData = testData + 4;
        //L[i].Z = testData + 4;

           A = str;
        B = L.Count;
      }



      

      //Reset Point List

      //A = testData;
      testPoint = new Point3d(L[i].X, L[i].Y, testData);
      test.Add(testPoint);
    }


    C = test;
# ---------- end list_item ----------
